# Dynamo graph GoogleSheetAPITest.dyn (Dynamo 2.0.3.8810)

string = StringInput("estimation")
getGoogleSpreadsheets = BIMOne.GoogleAPI.GetGoogleSpreadsheets(filter=string)
code_block = CodeBlock(item=getGoogleSpreadsheets.fileIds) { item[1]; }
getSheetsInSpreadsheet = BIMOne.GoogleAPI.GetSheetsInSpreadsheet(spreadsheetID=code_block)
string_2 = StringInput("A:AA")
readGoogleSheet = BIMOne.GoogleAPI.ReadGoogleSheet(spreadsheetId=code_block, sheet=getSheetsInSpreadsheet.sheetTitles, range=string_2)  # frozen
string_3 = StringInput("TEST123")
boolean = BoolSelector(true)
appendDataToGoogleSheetsTable = BIMOne.GoogleAPI.AppendDataToGoogleSheetsTable(spreadsheetId=code_block, sheet=getSheetsInSpreadsheet.sheetTitles, range=string_2, data=string_3, includeValuesInResponse=boolean)  # frozen
string_4 = StringInput("TEST_NEW")
writeDataToGoogleSheets = BIMOne.GoogleAPI.WriteDataToGoogleSheets(spreadsheetId=code_block, sheet=string_4, range=string_2, data=string_3, includeValuesInResponse=boolean)  # frozen
clearValuesInRangeGoogleSheet = BIMOne.GoogleAPI.ClearValuesInRangeGoogleSheet(spreadsheetId=code_block, sheet=string_4, range=string_2)  # frozen
createSheet = BIMOne.GoogleAPI.CreateSheet(spreadsheetID=code_block, newSheetTitle=string_4)  # frozen
createSpreadsheet = BIMOne.GoogleAPI.CreateSpreadsheet(spreadsheetTitle=string_4, openInBrowser=boolean)  # frozen
code_block_2 = CodeBlock { []; }
readGoogleSheetMultipleRanges = BIMOne.GoogleAPI.ReadGoogleSheetMultipleRanges(spreadsheetId=code_block, ranges=code_block_2)
code_block_3 = CodeBlock { ["Résumé client", "1 - Préliminaire"]; }
