# Dynamo graph GoogleSheetAPITest_v2.dyn (Dynamo 2.0.4.12684)

string = StringInput("api test bimone")
getGoogleSheetsInGoogleDrive = BIMOne.GoogleAPI.GetGoogleSheetsInGoogleDrive(filter=string)
code_block = CodeBlock(item=getGoogleSheetsInGoogleDrive.fileIds) { item[0]; }
getSheetsInGoogleSheet = BIMOne.GoogleAPI.GetSheetsInGoogleSheet(spreadsheetID=code_block)
string_2 = StringInput("A:AA")
readGoogleSheet = BIMOne.GoogleAPI.ReadGoogleSheet(spreadsheetId=code_block, sheet=getSheetsInGoogleSheet.sheetTitles, range=string_2)  # frozen
string_3 = StringInput("TEST_NEW")
string_4 = StringInput("test")
clearValuesInRangeGoogleSheet = BIMOne.GoogleAPI.ClearValuesInRangeGoogleSheet(spreadsheetId=code_block, sheet=string_3, range=string_2, search=string_4)  # frozen
code_block_2 = CodeBlock { []; }
readGoogleSheetMultipleRanges = BIMOne.GoogleAPI.ReadGoogleSheetMultipleRanges(spreadsheetId=code_block, ranges=code_block_2)  # frozen
code_block_3 = CodeBlock { ["Résumé client", "1 - Préliminaire"]; }
string_5 = StringInput("sheet1:A1")
boolean = BoolSelector(true)
appendDataToGoogleSheetTable = BIMOne.GoogleAPI.AppendDataToGoogleSheetTable(spreadsheetId=code_block, sheet=getSheetsInGoogleSheet.sheetTitles, range=string_2, data=string_5, includeValuesInResponse=boolean)  # frozen
createNewSheetWithinGoogleSheet = BIMOne.GoogleAPI.CreateNewSheetWithinGoogleSheet(spreadsheetID=code_block, newSheetTitle=string_3)  # frozen
createNewGoogleSheet = BIMOne.GoogleAPI.CreateNewGoogleSheet(spreadsheetTitle=string_3, openInBrowser=boolean)  # frozen
writeDataToGoogleSheet = BIMOne.GoogleAPI.WriteDataToGoogleSheet(spreadsheetId=code_block, sheet=string_3, range=string_2, data=string_5, includeValuesInResponse=boolean)  # frozen
getSheetsInGoogleSheet_2 = BIMOne.GoogleAPI.GetSheetsInGoogleSheet(spreadsheetID=code_block)  # frozen
code_block_4 = CodeBlock(item=getSheetsInGoogleSheet_2.sheetIds) { item[1]; }
toNumber = String.ToNumber(str=code_block_4)
deleteSheetByIdWithinGoogleSheet = BIMOne.GoogleAPI.DeleteSheetByIdWithinGoogleSheet(spreadsheetID=code_block, sheetId=toNumber)  # frozen
string_6 = StringInput("Sheet2")
deleteSheetByTitleWithinGoogleSheet = BIMOne.GoogleAPI.DeleteSheetByTitleWithinGoogleSheet(spreadsheetID=code_block, sheetTitle=string_6)  # frozen
list_create = List.Create(item0=string_5)
string_7 = StringInput("sheet2:A1")
string_8 = StringInput("sheet2:B1")
list_create_2 = List.Create(item0=string_7, item1=string_8)
list_create_3 = List.Create(item0=list_create_2)
list_create_4 = List.Create(item0=list_create, item1=list_create_3)
batchAppendDataToGoogleSheet = BIMOne.GoogleAPI.BatchAppendDataToGoogleSheet(spreadsheetId=code_block, sheets=getSheetsInGoogleSheet.sheetTitles, data=list_create_4, includeValuesInResponse=boolean)  # frozen
copyGoogleSheet = BIMOne.GoogleAPI.CopyGoogleSheet(fileId=code_block)
